# Grasshopper definition Trekkekum.gh (Grasshopper 1.0.8)
# plug-ins: Electronova_test

number_slider = Slider(50, range=0..100)
number_slider_2 = Slider(700, range=0..1000)
addition = Addition(A=number_slider_2, B=number_slider)
toppramme = Toppramme(
    Width=1200,
    Height=Slider(100, range=0..100),
    Length=1000,
    WallThickness=10,
    BunnrammeAndHoveddelOffset=addition,
    SlantHeight=Slider(98, range=0..1000))
hoveddel = Hoveddel(Width=1200, Height=number_slider_2, Length=1000, WallThickness=10, BunnrammeOffset=number_slider)
bunnramme = Bunnramme(Width=1200, Height=number_slider, Length=1000, WallThickness=10)
deconstruct_brep = DeconstructBrep(Brep=toppramme)  # -> Faces, Edges, Vertices
